# Grasshopper definition test01.gh (Grasshopper 1.0.7)
# plug-ins: Kangaroo2 Components

# ---- group: RH_IN:count
count = Slider(20, range=2..20)

# ---- group: RH_IN:radius
radius = Slider(5, range=5..20)

# ---- group: RH_IN:thickness
radius_2 = Slider(1.1, range=0.1..1.1)

# ----
radius_3 = GetNumber(radius, AtLeast=1, AtMost=1, Maximum=1.797693135e+308, Minimum=-1.797693135e+308)
count_2 = GetNumber(count, AtLeast=1, AtMost=1, Maximum=1.797693135e+308, Minimum=-1.797693135e+308)
thickness = GetNumber(radius_2, AtLeast=1, AtMost=1, Maximum=1.797693135e+308, Minimum=-1.797693135e+308)
sph = Sphere(Base=PlaneXY(0, 0, 0), Radius=radius_3)
pt = ConstructPoint(XCoordinate=0, YCoordinate=0, ZCoordinate=0)
popgeo = PopulateGeometry(Geometry=sph, Count=count_2, Seed=1)
facet = FacetDome(Points=popgeo)  # -> Pattern, Dome
division = Division(A=radius, B="4")
ln = Line(StartPoint=pt, EndPoint=popgeo)
explode = Explode(Curve=facet.Pattern, Recursive=True)  # -> Segments, Vertices
ext = ExtendCurve(Curve=ln, Type=0, Start="0", End=division)
dupln = RemoveDuplicateLines(Lines=flatten(explode.Segments), Tolerance=0.01)
mp = MultiPipe(Curves=dupln, NodeSize=0.5, EndOffset=1, StrutSize=1, Segment=0, KinkAngle=0.6, CubeFit=0)
mp_2 = MultiPipe(Curves=ext, NodeSize=thickness, EndOffset=1, StrutSize=1, Segment=0, KinkAngle=0.6, CubeFit=0)
meshsubd = MeshFromSubD(SubD=mp, Density=2)
meshsubd_2 = MeshFromSubD(SubD=mp_2, Density=2)
preview = CustomPreview(Geometry=meshsubd, Material=ColourSwatch(SwatchColor=RGB(255, 255, 255)))
clean = CombineClean(Meshes=[meshsubd, meshsubd_2])
medges = MeshEdges(Mesh=clean)  # -> NakedEdges, InteriorEdges, NonManifoldEdges
demesh = DeconstructMesh(Mesh=clean)  # -> Vertices, Faces, Colours, Normals
rev = Reverse(Vector=demesh.Normals)

# ---- group: RH_OUT:edges
crv = Curve([medges.NakedEdges, medges.InteriorEdges])

# ----
conmesh = ConstructMesh(Vertices=demesh.Vertices, Faces=demesh.Faces, Colours=rev)

# ---- group: RH_OUT:mesh
mesh = Mesh(conmesh)
