# Grasshopper definition test02_Kangaroo.gh (Grasshopper 1.0.7)
# plug-ins: Kangaroo2 Components, Weaverbird

# ---- group: RH_IN:count
number_slider = Slider(1.2, range=1..5)

# ---- group: RH_IN:radius
radius = Slider(5, range=5..20)

# ---- group: RH_IN:thickness
radius_2 = Slider(1.1, range=0.1..1.1)

# ----
radius_3 = GetNumber(radius, AtLeast=1, AtMost=1, Maximum=1.797693135e+308, Minimum=-1.797693135e+308)
count = GetNumber(number_slider, AtLeast=1, AtMost=1, Maximum=1.797693135e+308, Minimum=-1.797693135e+308)
thickness = GetNumber(radius_2, AtLeast=1, AtMost=1, Maximum=1.797693135e+308, Minimum=-1.797693135e+308)
custom_mesh_settings = SettingsCustom(
    StitchSeams=True,
    SimplePlanes=False,
    Refine=True,
    MinCount=16,
    MaxCount=400,
    AspectRatio=20,
    MaxDistance=0,
    MaxAngle=20,
    MinEdge=0,
    MaxEdge=0)
sph = Sphere(Base=PlaneXY(0, 0, 0), Radius=radius_3)
mesh = MeshBrep(Brep=sph, Settings=custom_mesh_settings)
weld = WeldMesh(Mesh=mesh, Angle=3.141592654)
demesh = DeconstructMesh(Mesh=weld)  # -> Vertices, Faces, Colours, Normals

# ----
# Funciona pero tarda mucho
demesh_2 = DeconstructMesh(Mesh=mesh)  # -> Vertices, Faces, Colours, Normals; disabled
bbox = BoundingBox(Content=mesh, Plane=PlaneXY(0, 0, 0))  # -> Box, Box_2; disabled
panel = Panel("1.1")  # disabled
scale = Scale(Geometry=bbox.Box, Center=Point(0, 0, 0), Factor=panel)  # -> Geometry, Transform; disabled
panel_2 = Panel("10")  # disabled
panel_3 = Panel("True")  # disabled
panel_4 = Panel("1000")  # disabled
edgelengths = EdgeLengths(Mesh=mesh, LengthFactor=count, Strength=panel_2)  # disabled
spc = SolidPointCollide(Points=demesh_2.Vertices, Solid=scale.Geometry, Interior=panel_3, Unidirectional=True, Strength=panel_4)  # disabled
show = Show(G=mesh)  # disabled
merge = Merge(Data1=show, Data2=edgelengths, Data3=spc)  # -> flatten(Result); disabled
zombiesolver = ZombieSolver(GoalObjects=merge, Threshold=1e-10, Tolerance=0.0001, MaxIterations=50000)  # -> I, V, O; disabled
item = ListItem(List=zombiesolver.O, Index=0, Wrap=True)  # disabled
clean = CleanTree(RemoveNulls=True, RemoveInvalid=True, RemoveEmpty=False, Tree=item)  # disabled

vec = Vector(demesh.Normals)
jitter = Jitter(List=vec, Jitter=1, Seed=count)  # -> Values, Indices
lng = ListLength(List=vec)
division = Division(A=lng, B=2)
split = SplitList(List=jitter.Values, Index=division)  # -> ListA, ListB
rev = Reverse(Vector=split.ListB)
division_2 = Division(A=thickness, B="10")
wbedges = WeaverbirdsMeshEdges(MeshOrPolylines=mesh)
merge_2 = Merge(Data1=split.ListA, Data2=rev)
mp = MultiPipe(Curves=wbedges, NodeSize=division_2, EndOffset=1, StrutSize=1, Segment=0, KinkAngle=0.6, CubeFit=0, Caps=0)
sort = SortList(Keys=jitter.Indices, ValuesA=merge_2)  # -> Keys, ValuesA
amp = Amplitude(Vector=sort.ValuesA, Amplitude=count)
meshsubd = MeshFromSubD(SubD=mp, Density=2)
addition = Addition(A=demesh.Vertices, B=amp)
pt = Point(Point(0, 0, 0))
conmesh = ConstructMesh(Vertices=addition, Faces=demesh.Faces)
demesh_3 = DeconstructMesh(Mesh=conmesh)  # -> Vertices, Faces, Colours, Normals
dist = Distance(PointA=pt, PointB=demesh_3.Vertices)
bnd = Bounds(Numbers=dist)
dedomain = DeconstructDomain(Domain=bnd)  # -> Start, End
gradient = Gradient(LowerLimit=dedomain.Start, UpperLimit=dedomain.End, Parameter=dist, stops=[0.179: RGB(255, 0, 0), 1: RGB(138, 43, 226)])
conmesh_2 = ConstructMesh(Vertices=demesh_3.Vertices, Faces=demesh_3.Faces, Colours=gradient)
wbcatmullclark = WeaverbirdsCatmullClarkSubdivision(MeshCurves=conmesh_2, Level="2", SmoothNakedEdges=1)
scale_2 = Scale(Geometry=wbcatmullclark, Center=Point(0, 0, 0), Factor="1.2")  # -> Geometry, Transform
wbedges_2 = WeaverbirdsMeshEdges(MeshOrPolylines=wbcatmullclark)
crv = Curve(wbedges_2)
lng_2 = ListLength(List=crv)
dup = DuplicateData(Data="255,255,0", Number=lng_2, Order=True)
c_script = CSharpScript(crv=crv, color=dup)  # -> out, A; inputs crv: Curve, color: Color
# ---------- c_script: C# ----------
    var c = color.R + "," + color.G + "," + color.B;
    crv.SetUserString("color", c);
    A = crv;
# ---------- end c_script ----------

# ---- group: RH_OUT:edges
# To apply the showcase the colors
# of the mesh do not use combine
# and clean or they will be erased.
curve = Curve(flatten(c_script.A))

# ---- group: RH_OUT:mesh
mesh_2 = Mesh(wbcatmullclark)

# ---- group: RH_OUT:mesh_cage
mesh_3 = Mesh(meshsubd)
