# Grasshopper definition test02_Kangaroo.gh (Grasshopper 1.0.7)
# plug-ins: Kangaroo2 Components, Weaverbird

# ---- group: RH_IN:length
number_slider = Slider(3, range=1..5)

# ---- group: RH_IN:radius
radius = Slider(5, range=5..20)

# ---- group: RH_IN:thickness
radius_2 = Slider(0.2, range=0.2..1.5)

# ----
radius_3 = GetNumber(radius, AtLeast=1, AtMost=1, Maximum=1.797693135e+308, Minimum=-1.797693135e+308)
length = GetNumber(number_slider, AtLeast=1, AtMost=1, Maximum=1.797693135e+308, Minimum=-1.797693135e+308)
thickness = GetNumber(radius_2, AtLeast=1, AtMost=1, Maximum=1.797693135e+308, Minimum=-1.797693135e+308)
custom_mesh_settings = SettingsCustom(
    StitchSeams=True,
    SimplePlanes=False,
    Refine=True,
    MinCount=16,
    MaxCount=400,
    AspectRatio=20,
    MaxDistance=0,
    MaxAngle=20,
    MinEdge=0,
    MaxEdge=0)
sph = Sphere(Base=PlaneXY(0, 0, 0), Radius=radius_3)
mesh = MeshBrep(Brep=sph, Settings=custom_mesh_settings)
demesh = DeconstructMesh(Mesh=mesh)  # -> Vertices, Faces, Colours, Normals
bbox = BoundingBox(Content=mesh, Plane=PlaneXY(0, 0, 0))  # -> Box, Box_2
scale = Scale(Geometry=bbox.Box, Center=Point(0, 0, 0), Factor="1.1")  # -> Geometry, Transform
edgelengths = EdgeLengths(Mesh=mesh, LengthFactor=length, Strength="10")
spc = SolidPointCollide(Points=demesh.Vertices, Solid=scale.Geometry, Interior="True", Unidirectional=True, Strength="1000")
show = Show(G=mesh)
merge = Merge(Data1=show, Data2=edgelengths, Data3=spc)  # -> flatten(Result)
zombiesolver = ZombieSolver(GoalObjects=merge, Threshold=1e-10, Tolerance=0.0001, MaxIterations=50000)  # -> I, V, O
division = Division(A=thickness, B="10")
wbedges = WeaverbirdsMeshEdges(MeshOrPolylines=mesh)
item = ListItem(List=zombiesolver.O, Index=0, Wrap=True)
mp = MultiPipe(Curves=wbedges, NodeSize=division, EndOffset=1, StrutSize=1, Segment=0, KinkAngle=0.6, CubeFit=0, Caps=0)
clean = CleanTree(RemoveNulls=True, RemoveInvalid=True, RemoveEmpty=False, Tree=item)
meshsubd = MeshFromSubD(SubD=mp, Density=2)
demesh_2 = DeconstructMesh(Mesh=clean)  # -> Vertices, Faces, Colours, Normals
pt = Point(Point(0, 0, 0))
dist = Distance(PointA=pt, PointB=demesh_2.Vertices)
bnd = Bounds(Numbers=dist)
dedomain = DeconstructDomain(Domain=bnd)  # -> Start, End
gradient = Gradient(LowerLimit=dedomain.Start, UpperLimit=dedomain.End, Parameter=dist, stops=[0.179: RGB(255, 0, 0), 1: RGB(138, 43, 226)])
conmesh = ConstructMesh(Vertices=demesh_2.Vertices, Faces=demesh_2.Faces, Colours=gradient)
wbcatmullclark = WeaverbirdsCatmullClarkSubdivision(MeshCurves=conmesh, Level="2", SmoothNakedEdges=1)
scale_2 = Scale(Geometry=wbcatmullclark, Center=Point(0, 0, 0), Factor="1.2")  # -> Geometry, Transform
wbedges_2 = WeaverbirdsMeshEdges(MeshOrPolylines=scale_2.Geometry)
crv = Curve(wbedges_2)
lng = ListLength(List=crv)
dup = DuplicateData(Data="255,255,0", Number=lng, Order=True)
c_script = CSharpScript(crv=crv, color=dup)  # -> out, A; inputs crv: Curve, color: Color
# ---------- c_script: C# ----------
    var c = color.R + "," + color.G + "," + color.B;
    crv.SetUserString("color", c);
    A = crv;
# ---------- end c_script ----------

# ---- group: RH_OUT:edges
# To apply the showcase the colors
# of the mesh do not use combine
# and clean or they will be erased.
curve = Curve(flatten(c_script.A))

# ---- group: RH_OUT:mesh
mesh_2 = Mesh(scale_2.Geometry)

# ---- group: RH_OUT:mesh_cage
mesh_3 = Mesh(meshsubd)
